# Grasshopper definition data_visualize.gh (Grasshopper 1.0.7)

filter = StreamFilter(Gate=Toggle(True), Stream0="nodes_in", Stream1="nodes_out")
python = GhPythonScript(index=Slider(379, range=0..2154), data_type=filter)  # -> out, num_items, cur_json, a; inputs index: Int32
# ---------- python: Python ----------
__author__ = "YYang"
__version__ = "2022.11.05"

import rhinoscriptsyntax as rs
import Rhino.Geometry as rg
import json
import os

gh_path = ghdoc.Path
split_gh_path = gh_path.split('\\')
split_gh_path.pop(-1)
print split_gh_path
split_gh_path.append('data\\room_base_graph\\{}'.format(data_type))
path_to_json = '\\'.join(split_gh_path)
print path_to_json
#path_to_json = 'C:\\Users\\yyang\\Documents\\github\\BoxStacker\\data\\room_base_graph\\{}'.format(data_type)
json_files = [pos_json for pos_json in os.listdir(path_to_json) if pos_json.endswith('.json')]

print(json_files[index])
cur_json = json_files[index]
cur_path = os.path.join(path_to_json, json_files[index])

with open (cur_path, 'r') as f:
    data = json.load(f)
    polylines = []
    for item in data['corners']:
        polyline = rg.Polyline()
        for pt in item:
            print pt
            cur_pt = rg.Point3d(pt[0], pt[1], 0)
            polyline.Add(cur_pt)
        polylines.append(polyline)
a = polylines
num_items = len(json_files)
# ---------- end python ----------
panel = Panel(python.cur_json)
panel_2 = Panel(python.num_items)
